# Grasshopper definition MOGE2k25_ACOUSTIC SIM MASTER FILE.gh (Grasshopper 1.0.7)
# plug-ins: PachydermGH, Pufferfish

# ---- group: RUN THE SIMULATION
toggle = BooleanToggle(False)

# ---- group: receiver
pt = Point(<point referenced from the Rhino model>)

# ---- group: emitter
pt_2 = Point(<point referenced from the Rhino model>)

# ----
# INPUT
pt_3 = Point(<point referenced from the Rhino model>)
cluster = Cluster(G=pt_3, pt_2=pt_2)

# ---- group: generated panel
srf = Surface(cluster)

# ----
cutofftime = Slider(5000, range=0..5000)
transitionorder = Slider(2, range=0..10)
number_of_rays = Slider(10000, range=0..500000)

# ---- group: emitter
pt_4 = Point(pt_2)

# ----
# Acoustic calculations
toggle_2 = BooleanToggle(True)
brep = Brep(srf)
polygon_scene = PolygonScene(RhinoGeometry=toggle_2, GrasshopperGeometry=brep, GrasshopperLayers="14", VoxelGridDepth=7)
bool = Boolean(toggle)
new_people_speaking_frequencies = Number([77.5, 72.5, 72, 73, 68, 66.5, 59, 51])
dispatch = Dispatch(List=polygon_scene, DispatchPattern=bool)  # -> ListA, ListB
geodesic_omnidirectional_source_object = GeodesicSource(Origin=pt_4, Power=new_people_speaking_frequencies, Delay=0)
stationary_receiver = StationaryReceiver(
    Origin=pt,
    Sources=geodesic_omnidirectional_source_object,
    RoomModel=dispatch.ListA,
    SampleFrequency=44100,
    CutOffTime=cutofftime)
image_source = ImageSource(
    RoomModel=dispatch.ListA,
    Reflection_Order=transitionorder,
    Source=geodesic_omnidirectional_source_object,
    Receiver=stationary_receiver,
    EdgeDiffraction=Toggle(False))  # -> ImageSourceData, ReflectionTag, Reflections
direct_sound = DirectSound(RoomModel=dispatch.ListA, Source=geodesic_omnidirectional_source_object, Receiver=stationary_receiver)
ray_tracing = RayTracing(
    RoomModel=dispatch.ListA,
    NumberOfRays=number_of_rays,
    CutOffTime=cutofftime,
    ImageSourceOrder=transitionorder,
    Source=geodesic_omnidirectional_source_object,
    Receiver=stationary_receiver,
    FrequencyScope=Domain(0, 7))
energy_time_curve = EnergyTimeCurve(DirectSound=direct_sound, ImageSource=image_source.ImageSourceData, RayTracing=ray_tracing)
reverberation_time = ReverberationTime(EnergyTimeCurve=energy_time_curve, DecayIndex="30")

# ----
# PANEL POSITIONING FOR NN
pdecon = Deconstruct(Point=pt_3)  # -> XComponent, YComponent, ZComponent
X = Number(5.199687224)
Y = Number(4.624390241)
offsrf = OffsetSurface(Surface=srf, Distance=Slider(0.2, range=0..1), BothSides=0, CreateSolid=True)
item = ListItem(List=reverberation_time, Index=Slider(3, range=0..10), Wrap=True)
num = Number([1.882281058, 1.985929084, 2.10799155, 2.208357468, 2.298429694, 2.341430757, 2.251853128, 1.916561356])
panel = Panel(item)
list_item = ListItem(List=num, Index=0, Wrap=True)
panel_2 = Panel(num)

# ----
# PANEL POSITIONING FOR NN
points_for_neural_network_training = Panel("""16.2417;0.3260
3.3589;0.5824
4.8107;7.5146
16.9710;7.8376
11.1042;4.6202
14.0139;6.9359
4.3444;5.1460
9.5505;2.2337
9.1486;8.4580
17.8920;5.3001
19.4516;1.2774
14.8565;1.6740
22.1225;3.0288
0.9094;5.7493
7.9443;2.7807
7.0214;3.5063
20.0500;6.2219
23.0672;6.5315
1.6907;2.0547
12.1857;4.1637""")
concat = Concatenate(FragmentA=points_for_neural_network_training, FragmentB="0", JoinSeparator=";")
split = TextSplit(Text=concat, Separators=";")
join = TextJoin(Text=split, Join=", ")
concat_2 = Concatenate(FragmentA="{", FragmentB=join, FragmentC="}")
pt_5 = Point(flatten(concat_2))
pt_6 = Point(pt_2)
number_slider = Slider(1, range=0..10)
Z = UnitZ(Factor=1)
dom = ConstructDomain(DomainStart=0, DomainEnd=Slider(2, range=0..10))
dom_2 = ConstructDomain(DomainStart=expr("-x", number_slider), DomainEnd=number_slider)

# ----
# SPOSTAMENTO DEI PUNTI
# CHE INCONTRANO OSTACOLI
number_slider_2 = Slider(0, range=0..19)
number_slider_3 = Slider(1, range=0..19)
item_2 = ListItem(List=pt_5, Index=number_slider_3, Wrap=True)
item_3 = ListItem(List=pt_5, Index=number_slider_2, Wrap=True)
Y_2 = UnitY(Factor=Slider(0.7, range=0..1))
move = Move(Geometry=item_3, Motion=Y_2)  # -> Geometry, Transform
move_2 = Move(Geometry=item_2, Motion=Y_2)  # -> Geometry, Transform
merge = Merge(Data1=move.Geometry, Data2=move_2.Geometry)
merge_2 = Merge(Data1=number_slider_2, Data2=number_slider_3)
replace = ReplaceItems(List=pt_5, Item=merge, Indices=merge_2, Wrap=False)

ln = Line(StartPoint=pt_6, EndPoint=simplify(replace))
pl = PlaneNormal(Origin=replace, ZAxis=ln)
align = AlignPlane(Plane=pl, Direction=Z)  # -> Plane, Angle
rectangle = Rectangle(Plane=align.Plane, XSize=dom, YSize=dom_2, Radius=0)  # -> Rectangle, Length
boundary = BoundarySurfaces(Edges=rectangle.Rectangle)

# ---- group: PANELS FOR NN TRAINING
srf_2 = Surface(boundary)

# ==== cluster Cluster
G = ClusterInput()
project = Project(Geometry=G, Plane=PlaneXY(0, 0, 0))  # -> Geometry, Transform
pt = Point(project.Geometry)
pt_2 = ClusterInput()
pt_3 = Point(pt_2)
ln = Line(StartPoint=pt_3, EndPoint=simplify(pt))
number_slider = Slider(1, range=0..10)
pl = PlaneNormal(Origin=pt, ZAxis=ln)
Z = UnitZ(Factor=1)
align = AlignPlane(Plane=pl, Direction=Z)  # -> Plane, Angle
dom = ConstructDomain(DomainStart=0, DomainEnd=Slider(2, range=0..10))
dom_2 = ConstructDomain(DomainStart=expr("-x", number_slider), DomainEnd=number_slider)
rectangle = Rectangle(Plane=align.Plane, XSize=dom, YSize=dom_2, Radius=0)  # -> Rectangle, Length
boundary = BoundarySurfaces(Edges=rectangle.Rectangle)
S = ClusterOutput(boundary)
