# Grasshopper definition MOGE2k25_Neural Network Implementation_wPUG.gh (Grasshopper 1.0.7)
# plug-ins: Pug, LunchBox, Tree8, treesloth01

# ----
# DATA PREPROCESSING
dati_delle_simulazioni = Panel("""X;Y; Tr 500HZ 
16,2417;1,0260; 1,066 
3,3589;1,2824; 1,131 
4,8107;7,5146; 1,060 
16,9710;7,8376; 1,091 
11,1042;4,6202; 1,084 
14,0139;6,9359; 1,119 
4,3444;5,1460; 1,073 
9,5505;2,2337; 1,439 
9,1486;8,4580; 1,218 
17,8920;5,3001; 1,070 
19,4516;1,2774; 1,103 
14,8565;1,6740; 1,064 
22,1225;3,0288; 1,224 
0,9094;5,7493; 1,086 
7,9443;2,7807; 1,013 
7,0214;3,5063; 0,998 
20,0500;6,2219; 1,044 
23,0672;6,5315; 1,099 
1,6907;2,0547; 1,108 
12,1857;4,1637; 1,034 """)
csv = ReadCSV(CSVString=dati_delle_simulazioni, Delimiter=";")  # -> Headers, Values
txt = Text(csv.Values)
rep = ReplaceText(Text=txt, Find=",", Replace=".", RecursiveReplace=False)
bang = ExplodeTree(Data=rep)  # -> Branch0, Branch1, Branch2
entwine = Entwine(Branch00=bang.Branch0, Branch01=bang.Branch1, FlattenInputs=True)  # -> simplify(Result)
flip = FlipMatrix(Data=entwine)
number_slider = Slider(2, range=0..10)
tstat = TreeStatistics(Tree=flip)  # -> Paths, Length, Count
cull_i = CullIndex(List=tstat.Paths, Indices=number_slider, Wrap=True)
tbranch = TreeBranch(Tree=flip, Path=cull_i, MaintainPaths=True, SplitTree=False)
renumber = RenumberPaths(Data=tbranch)
coordinate_x_e_y_di_ogni_pannello = Panel(renumber)
item = ListItem(List=coordinate_x_e_y_di_ogni_pannello, Index=0, Wrap=True)  # -> Item, Item1

# ----
# NEURAL NETWORK DEFINITION
# INPUT LAYER
panel = Panel("""1
2""")
int = Integer(panel)
keras_layer = KerasLayer(Shape=int, mode="Input Layer")
keras_layer_2 = KerasLayer(Parent=keras_layer, mode="Flatten Layer")

# ----
# HIDDEN LAYERS
randomuniform = Slider(4, range=0..10)
relu = Slider(1, range=0..1)
size_acdc = Panel("64")
keras_layer_3 = KerasLayer(
    Parent=keras_layer_2,
    Size=size_acdc,
    Activator=relu,
    KernelInitializer=randomuniform,
    BiasInitializer=randomuniform,
    mode="Dense Layer")
relu_2 = Slider(1, range=0..1)
randomuniform_2 = Slider(4, range=0..10)
size_acdc_2 = Panel("32")
keras_layer_4 = KerasLayer(
    Parent=keras_layer_3,
    Size=size_acdc_2,
    Activator=relu_2,
    KernelInitializer=randomuniform_2,
    BiasInitializer=randomuniform_2,
    mode="Dense Layer")
relu_3 = Slider(1, range=0..1)
size_acdc_3 = Panel("16")
keras_layer_5 = KerasLayer(
    Parent=keras_layer_4,
    Size=size_acdc_3,
    Activator=relu_3,
    KernelInitializer=randomuniform_2,
    BiasInitializer=randomuniform_2,
    mode="Dense Layer")

# ----
# OUTPUT LAYER
relu_4 = Slider(1, range=0..10)
randomuniform_3 = Slider(4, range=0..10)
size_risultato_finale = Panel("1")
keras_layer_6 = KerasLayer(
    Parent=keras_layer_5,
    Size=size_risultato_finale,
    Activator=relu_4,
    KernelInitializer=randomuniform_3,
    BiasInitializer=randomuniform_3,
    mode="Dense Layer")

indice = Number(number_slider)
path = Data(tstat.Paths)
num = Number(flip)
item_2 = ListItem(List=path, Index=indice, Wrap=True)
tbranch_2 = TreeBranch(Tree=num, Path=item_2, MaintainPaths=True, SplitTree=False)
coordinate_x_e_y_di_ogni_pannello_2 = Panel(tbranch_2)

# ----
# COORDINATES FOR TEST
X = Number(5.199687224)
Y = Number(4.624390241)

# ----
# Y TRAIN (rev time)
number_slider_2 = Slider(2, range=0..10)
rev_time = Number(bang.Branch2)
cull_i_2 = CullIndex(List=rev_time, Indices=number_slider_2, Wrap=True)

# ---- group: NORMALIZATION
bnd = Bounds(Numbers=cull_i_2)
remap = RemapNumbers(Value=cull_i_2, Source=bnd, Target=" 0 to 1")  # -> Mapped, Clipped

# ----
panel_2 = Panel(remap.Mapped)

tensor = ConstructTensor(Values=flatten(panel_2), Shape="1")
panel_3 = Panel(tensor)

# ----
# X TRAIN (x, y coordinates)
Y_2 = Number(item.Item1)
X_2 = Number(item.Item)
flatten = FlattenTree(Tree=X_2, Path="{0}")
flatten_2 = FlattenTree(Tree=Y_2, Path="{0}")

# ---- group: Normalization
bnd_2 = Bounds(Numbers=flatten_2)
bnd_3 = Bounds(Numbers=flatten)
remap_2 = RemapNumbers(Value=flatten_2, Source=bnd_2, Target=" 0 to 1")  # -> Mapped, Clipped
remap_3 = RemapNumbers(Value=flatten, Source=bnd_3, Target=" 0 to 1")  # -> Mapped, Clipped

# ----
entwine_2 = Entwine(Branch00=remap_3.Mapped, Branch01=remap_2.Mapped, FlattenInputs=True)
flip_2 = FlipMatrix(Data=entwine_2)  # -> simplify(Data)
panel_4 = Panel(flip_2)

panel_5 = Panel("""1
2""")
tensor_2 = ConstructTensor(Values=flatten(panel_4), Shape=panel_5)
panel_6 = Panel(tensor_2)

# ----
# MODEL COMPILE AND TRAINING
panel_7 = Panel("STest5(50ep)_Surrogate_Model_estimation_of_RT_MOGE2k25")
keras_model = KerasModel(Layer=keras_layer_6, Name=panel_7, KerasOptimizer=Slider(0, range=0..100), LearningRate=0.001)
panel_8 = Panel("C:\Users\gnoce\Desktop\Giovanni\phd\Workshop moge\MOGE 2K25\model\ML IMPLEMENTATION\SENSITIVITY TEST")
panel_9 = Panel("""64
32
16""")
sl = SLAgent(
    Run=Toggle(False),
    X=tensor_2,
    Y=tensor,
    Hidden=panel_9,
    ANN=keras_model,
    Path=panel_8,
    BatchSize="19",
    Epochs=Slider(100, range=0..100),
    ValidationSplit=Slider(0, range=0..100),
    mode="Regression")  # -> Agent, MeanAbsoluteError

item_3 = ListItem(List=coordinate_x_e_y_di_ogni_pannello_2, Index=0, Wrap=True)  # -> Item, Item1
coord_y_domain = Domain(bnd_2)
Y_3 = Number(item_3.Item1)
X_3 = Number(item_3.Item)
coord_x_domain = Domain(bnd_3)
remap_4 = RemapNumbers(Value=Y_3, Source=coord_y_domain, Target=" 0 to 1")  # -> Mapped, Clipped
remap_5 = RemapNumbers(Value=X_3, Source=coord_x_domain, Target=" 0 to 1")  # -> Mapped, Clipped
merge = Merge(Data1=remap_5.Mapped, Data2=remap_4.Mapped)
test = Number(merge)

# ----
# XTEST
panel_10 = Panel(test)
panel_11 = Panel("""1
2""")
tensor_3 = ConstructTensor(Values=flatten(panel_10), Shape=panel_11)

path_2 = FilePath("C:\Users\gnoce\Desktop\Giovanni\phd\Workshop moge\MOGE 2K25\model\ML IMPLEMENTATION\SENSITIVITY TEST\STest4(50ep)_Surrogate_Model_estimation_of_RT_MOGE2k25.hd5")
# PREDICTION
predict = SLPredictData(Agent=sl.Agent, X=tensor_3, Path=path_2, mode="Regression")
predicted_rev_time = Panel(predict)
domain = Domain(Domain(0.998, 1.439))
remap_6 = RemapNumbers(Value=predict, Source=" 0 to 1", Target=domain)  # -> Mapped, Clipped
predicted_rev_time_denormalized = Panel(remap_6.Mapped)

number_slider_3 = Slider(1.06, range=0..10)
subtraction = Subtraction(A=number_slider_3, B=predicted_rev_time_denormalized)
abs = Absolute(Value=subtraction)
division = Division(A=abs, B=number_slider_3)
multiplication = Multiplication(A=division, B=100)
errore_percentuale = Panel(multiplication)
